# Dynamo graph FindAndReplaceParameters.dyn (Dynamo 1.3.2.2480)

# group: Select Category
categories = Categories("ElectricalEquipment")
all_elements_of_category = ElementsOfCategory(categories)

string = StringInput("Panel Name")
getParameterValueByName = Element.GetParameterValueByName(element=all_elements_of_category, parameterName=string)
code_block = CodeBlock { "PDU"; }
contains = String.Contains(str=getParameterValueByName, searchFor=code_block)
filterByBoolMask = List.FilterByBoolMask(list=all_elements_of_category, mask=contains)
flatten = Flatten(filterByBoolMask.in)
id = Element.Id(flatten)

# group: Group the tags by the element ids (this is for when something is tagged multiple times or in multiple views)
groupByKey = List.GroupByKey(list=flatten, keys=id)

# group: Dictionaries provide a way to look stuff up by a given key
code_block_2 = CodeBlock(taggedElement=groupByKey.groups, tag=groupByKey.unique_keys)
# ---------- code_block_2.designscript (4 lines) ----------
//declare a new dictionary to store this in
tagDictionary = {};
//dictionary[whatToLookUpBy] = tagElement
tagDictionary[taggedElement] = tag;
# ----------------------------------------

select_model_elements = DSModelElementsSelection()  # 298 picked in the model

# group: Sample element selected manually to get the tags for
id_2 = Element.Id(select_model_elements)

# group: Retrieve the related tags for the given element from the dictionary
code_block_3 = CodeBlock(tagDictionary=code_block_2.tagDictionary, taggedElement=id_2) { tagDictionary[taggedElement]; }

clean = List.Clean(list=code_block_3@L1)
flatten_2 = Flatten(clean)

# group: Select Phase of Elements
select_phase = RevitPhases("Existing")

byPhaseCreated = Revit.ElementFilter.ByPhaseCreated(flatten_2, select_phase)

# group: Type in Parameter Name
string_2 = StringInput("Panel Name")

watch = Watch(string_2)
getParameterValueByName_2 = Element.GetParameterValueByName(element=byPhaseCreated, parameterName=watch)
code_block_4 = CodeBlock { " "; }

# group: Find and Replace Node. Type in the Strings
string_3 = StringInput("-")
replace = String.Replace(str=getParameterValueByName_2, searchFor=code_block_4, replaceWith=string_3)

setParameterByName = Element.SetParameterByName(element=byPhaseCreated, parameterName=watch, value=replace)
string_4 = StringInput("PHASE BY SUITE")

# group: Select an element of the category you would like to Find Replace
select_model_element = DSModelElementSelection()

getCategory = Element.GetCategory(select_model_element)
all_elements_of_category_2 = ElementsOfCategory(getCategory)
string_5 = StringInput("Location")
