# Dynamo graph FindPanelByName v1.3.2.dyn (Dynamo 1.3.2.2480)

categories = Categories("ElectricalEquipment")
all_elements_of_category = ElementsOfCategory(categories)
code_block = CodeBlock { "Panel Name"; }
getParameterValueByName = Element.GetParameterValueByName(element=all_elements_of_category, parameterName=code_block)
string = StringInput("AMH")
eq = getParameterValueByName == string
filterByBoolMask = List.FilterByBoolMask(list=all_elements_of_category, mask=eq)
watch = Watch(filterByBoolMask.in)
contains = String.Contains(str=getParameterValueByName, searchFor=string)
filterByBoolMask_2 = List.FilterByBoolMask(list=all_elements_of_category, mask=contains)
watch_2 = Watch(filterByBoolMask_2.in)
