# Dynamo graph 1.3.2 WEAVE.dyn (Dynamo 1.3.2.2480)

select_model_element = DSModelElementSelection()
select_model_element_2 = DSModelElementSelection()
select_model_element_3 = DSModelElementSelection()
select_model_element_4 = DSModelElementSelection()
select_model_element_5 = DSModelElementSelection()
select_model_element_6 = DSModelElementSelection()
join = List.Join(select_model_element, select_model_element_2, select_model_element_3, select_model_element_4, select_model_element_5, select_model_element_6)
code_block = CodeBlock { 5; }
python_script = Python(IN[0]=code_block)
# ---------- python_script.python (24 lines) ----------
import clr
clr.AddReference('ProtoGeometry')
from Autodesk.DesignScript.Geometry import *
#The inputs to this node will be stored as a list in the IN variables.
n = UnwrapElement(IN[0])

def pairs(n):
    for diff in range(1, n):
        starts_seen = set()
        index = 0
        for i in range(n):
            pair = [index]
            starts_seen.add(index)
            index = (index+diff) % n
            pair.append(index)
            yield pair
            index = (index+diff) % n
            if index in starts_seen:
                index = (index+1) % n


#Assign your output to the OUT variable.
PAIRS = list(pair for pair in pairs(n))
OUT = PAIRS
# ----------------------------------------
watch = Watch(python_script)
chop = List.Chop(list=watch, lengths=code_block)

# group: GET MECHANICAL CONNECTIONS -
family_types = FamilyTypes("ID MECH CONNECTION:MECHANICAL CONNECTION (120V)")
string = StringInput("EQUIPMENT NAME_IDG")
number = DoubleInput(1)

all_elements_of_family_type = ElementsOfFamilyType(family_types)
family_types_2 = FamilyTypes("ID MECH CONNECTION:MECHANICAL CONNECTION (480V)")
all_elements_of_family_type_2 = ElementsOfFamilyType(family_types_2)
create = List.Create(all_elements_of_family_type, all_elements_of_family_type_2)

# group: FILTER BY PHASE
select_phase = RevitPhases("Suite 224")
byPhaseCreated = Revit.ElementFilter.ByPhaseCreated(create, select_phase)
number_2 = DoubleInput(1)
flatten = List.Flatten(list=byPhaseCreated, amt=number_2)

# group (continued): GET MECHANICAL CONNECTIONS -
getParameterValueByName = Element.GetParameterValueByName(element=flatten, parameterName=string)
groupByKey = List.GroupByKey(list=flatten, keys=getParameterValueByName)
flatten_2 = List.Flatten(list=groupByKey.groups, amt=number)
getParameterValueByName_2 = Element.GetParameterValueByName(element=flatten_2, parameterName=string)
duplicateItemIndicies = archilab.Lists.Lists.DuplicateItemIndicies(getParameterValueByName_2)
removeItemAtIndex = List.RemoveItemAtIndex(list=getParameterValueByName_2, indices=duplicateItemIndicies.out0)
removeItemAtIndex_2 = List.RemoveItemAtIndex(list=getParameterValueByName_2, indices=duplicateItemIndicies.out1)

file_path = Filename(".\Weave.xlsx")
code_block_2 = CodeBlock { "Sheet1"; }
code_block_3 = CodeBlock { 0; }
code_block_4 = CodeBlock { "A"; "B"; "C"; "D"; }
join_2 = List.Join(code_block_4.out0, code_block_4.out1, code_block_4.out2, code_block_4.out3)
watch_2 = Watch(join_2)
count = Count(watch_2)
python_script_2 = Python(IN[0]=count)  # same code as python_script
getItemAtIndex = List.GetItemAtIndex(list=watch_2, index=python_script_2@L2)
boolean = BoolSelector(true)
writeToFile = Excel.WriteToFile(filePath=file_path, sheetName=code_block_2, startRow=code_block_3, startCol=code_block_3, data=getItemAtIndex, overWrite=boolean)
